% Simulink data dictionary sharedTypesDic.sldd

DiStates = enum(StorageType="int8")
  OFF = 0
  ON = 1
  ERROR = 2
  UNDEF = 3

ChErrors = enum(StorageType="int8")
  OK = 0
  BRAKE = 1
  SHORT = 2
  UNDEF = 3

CAN_MESSAGE_BUS = Simulink.Bus()  % Стандартный тип данных Simulink для CAN_MESSAGE.
  % Генерируется коммандой: canMessageBusType
  Extended: uint8
  Length: uint8
  Remote: uint8
  Error: uint8
  ID: uint32
  Timestamp: double
  Data: uint8[8]

Statuses = enum(StorageType="int8")  % Общие статусы возврата
  ERROR = -1  % -1
  OK = 0  % 0
  BUSY = 1  % 1
  NO_CONNECT = 2  % 2
  OVERFLOW = 3  % 3
  NOT_FOUND = 4  % 4
  EMPTY = 5  % 5
  BREAK = 6  % 6
  SHORT_GND = 7  % 7
  SHORT_POWER = 8  % 8
  OUT_OF_RANGE = 9  % 9
  RESET_TO_DEFAULT = 10  % 10
  CHECKSUM_MISS = 11  % 11
  FLASH_ERROR = 12  % 12
  IS_EXIST = 13  % 13