% Simulink data dictionary can_control.sldd

CAN_Msg_t = Simulink.Bus(DataScope="Imported", HeaderFile="can_control.h")
  Extended: uint8
  Length: uint8
  Remote: uint8
  Error: uint8
  ID: uint32
  Timestamp: uint32
  Data: uint8[8]

CAN_MESSAGE_BUS = Simulink.Bus()
  Extended: uint8
  Length: uint8
  Remote: uint8
  Error: uint8
  ID: uint32
  Timestamp: double
  Data: uint8[8]